# Grasshopper definition 200722_VUILD_BusStop.gh (Grasshopper 1.0.7)
# plug-ins: karambaGH

number_slider = Slider(796, range=0..1000)
series = Series(Start=number_slider, Step=number_slider, Count=Slider(4, range=0..10))
panel = Panel("""0
500
1000
500
0""")
X = UnitX(Factor=series)
pt = Point(Point(0, 0, 0))
move = Move(Geometry=pt, Motion=X)  # -> Geometry, Transform
Y = UnitY(Factor=panel)
panel_2 = Panel("""2500
2750
3000
2750
2500""")
move_2 = Move(Geometry=flatten([pt, move.Geometry]), Motion=Y)  # -> Geometry, Transform
Z = UnitZ(Factor=panel_2)
move_3 = Move(Geometry=move_2.Geometry, Motion=Z)  # -> Geometry, Transform
vec = VectorXYZ(XComponent=0, YComponent=expr("-x", Slider(1411, range=0..10000)), ZComponent=Slider(347, range=0..1000))  # -> Vector, Length
rev = Reverse(Vector=expr("x/2", vec.Vector))
move_4 = Move(Geometry=move_3.Geometry, Motion=vec.Vector)  # -> Geometry, Transform
move_5 = Move(Geometry=move_3.Geometry, Motion=rev)  # -> Geometry, Transform

shift = ShiftList(List=move_4.Geometry, Shift=1, Wrap=True)
lng = ListLength(List=move_3.Geometry)  # -> expr("x-1", Length)
split = SplitList(List=shift, Index=lng)  # -> ListA, ListB
ln = Line(StartPoint=move_4.Geometry, EndPoint=split.ListA)

shift_2 = ShiftList(List=move_5.Geometry, Shift=1, Wrap=True)
lng_2 = ListLength(List=move_3.Geometry)  # -> expr("x-1", Length)
split_2 = SplitList(List=shift_2, Index=lng_2)  # -> ListA, ListB
ln_2 = Line(StartPoint=move_5.Geometry, EndPoint=split_2.ListA)

shift_3 = ShiftList(List=move_3.Geometry, Shift=1, Wrap=True)
lng_3 = ListLength(List=move_3.Geometry)  # -> expr("x-1", Length)
split_3 = SplitList(List=shift_3, Index=lng_3)  # -> ListA, ListB
ln_3 = Line(StartPoint=move_3.Geometry, EndPoint=split_3.ListA)

ln_4 = Line(StartPoint=move_5.Geometry, EndPoint=move_3.Geometry)
ln_5 = Line(StartPoint=move_3.Geometry, EndPoint=move_4.Geometry)

ln_6 = Line(StartPoint=move_2.Geometry, EndPoint=move_3.Geometry)
col = Line(flatten(ln_6))
beam = Line(flatten([ln_3, ln, ln_2]))
girder = Line(flatten([ln_5, ln_4]))
number_slider_2 = Slider(0.001, range=0..0.01)
scale = Scale(Geometry=beam, Center=Point(0, 0, 0), Factor=number_slider_2)  # -> Geometry, Transform

number_slider_3 = Slider(270, range=0..1000)
matprops = MaterialPropertiesKaramba3D(
    FamilyOfMaterial="Steel",
    Name="S235",
    YoungsModulus_kN_cm2=Slider(800, range=0..1000),
    InPlaneShearModulus_kN_cm2=number_slider_3,
    TransverseShearModulus_kN_cm2=number_slider_3,
    SpecificWeight_kN_m3=78.5,
    CoefficientOfThermalExpansion_1_C=1e-05,
    YieldStrength_kN_cm2=Slider(0.8, range=0..1),
    mode="Isotrop")

scale_2 = Scale(Geometry=col, Center=Point(0, 0, 0), Factor=number_slider_2)  # -> Geometry, Transform
scale_3 = Scale(Geometry=girder, Center=Point(0, 0, 0), Factor=number_slider_2)  # -> Geometry, Transform

# ---- group: COL
number_slider_4 = Slider(16, range=0..100)
cross_section = CrossSectionKaramba3D(
    FamilyNameOfCrossSection="DefaultCroSec",
    Material=matprops,
    Height_cm=number_slider_4,
    UpperFlangeWidth_cm=number_slider_4,
    LowerFlangeWidth_cm=number_slider_4,
    mode="Trapezoid")
linetobeam = LineToBeamKaramba3D(Line=scale_2.Geometry, CrossSection=cross_section, New=True, Remove=True, LimitDistance_m=0.005)  # -> Element, Points, Info

# ----
number_slider_5 = Slider(3, range=0..100)
cross_section_2 = CrossSectionKaramba3D(
    FamilyNameOfCrossSection="DefaultCroSec",
    Material=matprops,
    Height_cm=Slider(20, range=0..100),
    UpperFlangeWidth_cm=number_slider_5,
    LowerFlangeWidth_cm=number_slider_5,
    mode="Trapezoid")
number_slider_6 = Slider(0, range=0..1)
Z_2 = UnitZ(Factor=1)
Z_3 = UnitZ(Factor=Slider(1, range=0..10))
Y_2 = UnitY(Factor=Slider(0.5, range=0..1))
end = EndPoints(Curve=scale_2.Geometry)  # -> Start, End
neg = Negative(Value=Z_2)
neg_2 = Negative(Value=Z_3)
linetobeam_2 = LineToBeamKaramba3D(Line=scale.Geometry, CrossSection=cross_section_2, New=True, Remove=True, LimitDistance_m=0.005)  # -> Element, Points, Info
loads = LoadsKaramba3D(Vector=Y_2, LCase=Slider(1, range=0..1), mode="Gravity")
linetobeam_3 = LineToBeamKaramba3D(Line=scale_3.Geometry, Identifier="girder", CrossSection=cross_section_2, New=True, Remove=True, LimitDistance_m=0.005)  # -> Element, Points, Info
loads_2 = LoadsKaramba3D(Vector=neg, LCase=number_slider_6, mode="Gravity")
loads_3 = LoadsKaramba3D(Vector=neg_2, BeamIdentifiers="girder", LCase=number_slider_6, mode="Uniform Line", menu=[buttons(off, on, off)])
supp = SupportKaramba3D(PosInd=end.Start, menu=[buttons(on, on, on, off, off, off)])
assemble = AssembleModelKaramba3D(
    Elem=[linetobeam.Element, linetobeam_2.Element, linetobeam_3.Element],
    Support=supp,
    Load=[loads_2, loads_3, loads],
    LimitDistance_m=0.005)  # -> Model, Info, Mass_kg, CenterOfGravity
analyze = AnalyzeKaramba3D(Model=assemble.Model)  # -> CalculatedModel, MaximumDisplacement_cm, ResultingForceOfGravity_kN, ElasticEnergy_kNm
modelview = ModelViewKaramba3D(Model=analyze.CalculatedModel, ResultFactors=1, ResultCase=-1)  # -> Model, DeformedMesh, DeformedAxes, DeformedModel
beamview = BeamViewKaramba3D(Model=modelview.Model)  # -> Model, MeshesOfRenderedBeams, DeformedBeamAxes, LegendColors, LegendTags
legend = Legend(Colour=beamview.LegendColors, Tags=beamview.LegendTags, LegendType=101)
