# Grasshopper definition millipede_chair.gh (Grasshopper 1.0.7)
# plug-ins: Millipede, Weaverbird

brep = Brep(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)

brep_2 = Brep(<brep referenced from the Rhino model>)
load_region = LoadRegion(Boundary=brep_2, ArealNormalLoad=Slider(800, range=0..1000))

mesh_uv = MeshSurface(Surface=brep, UCount=Slider(20, range=0..100), VCount=Slider(27, range=0..100), Overhang=True, Equalize=False)

mat = Material(MaterialType=2)
femesh = FEMesh(Meshes=mesh_uv, Material=mat, Thickness=Slider(0.05, range=0..0.1), AreaLoad=Vector(0, 0, 0), NormalAreaLoad=0)

brep_3 = Brep(<brep referenced from the Rhino model>)
mat_2 = SupportType(X=True, Y=True, Z=True, RX=True, RY=True, RZ=True)
support_region = MSupportTypeRegion(Boundary=brep_3, SupportType=mat_2, AmmendExistingSupports=True)

fea_system = FEASystem(
    ModelComponents=flatten([femesh, load_region, support_region]),
    IntersectAddedCurves=True,
    MergeTolerance=0.0001,
    MinimumCurveSpan=0.05,
    MaximumCurveSpan=10000,
    CurveTolerance=0.1)
fe_solver = FESolver(
    FEModel=fea_system,
    SelfWeightCoefficient=1,
    BeamOptimisationIterations=0,
    QuadOptimisationIterations=Slider(12, range=0..100),
    OptimizationTarget=Slider(0.15, range=0..1),
    OptimizationPenalization=2,
    LoadCase=0,
    AllCases=True)  # -> FEModel, MaxDeflection, Weight
quad_results = QuadResults(FEModel=fe_solver.FEModel, Plane=1)  # -> PrincipalStressFrame, Area, NormalDisplacement, MaxVonMisesStress, PS1, PS2, StiffnessMultiplier, Bending
mesh_visualization = MeshVisualization(FEModel=fe_solver.FEModel, Deflection=0, Plane=1, ShowThickness=False, ColorMode=8)  # -> Mesh, CompleteRange, VisibleRange
stresslines = StressLines(FEModel=fe_solver.FEModel, Points=quad_results.PrincipalStressFrame, Plane=1)  # -> Stress1, Stress2
demesh = DeconstructMesh(Mesh=mesh_visualization.Mesh)  # -> Vertices, Faces, Colours, Normals
split = TextSplit(Text=demesh.Colours, Separators=",")
item = ListItem(List=split, Index=0, Wrap=True)  # -> flatten(Item)
remap = RemapNumbers(Value=item, Source="0 to 255", Target="0 to 3")  # -> Mapped, Clipped
amp = Amplitude(Vector=demesh.Normals, Amplitude=remap.Mapped)
move = Move(Geometry=demesh.Vertices, Motion=amp)  # -> Geometry, Transform
conmesh = ConstructMesh(Vertices=move.Geometry, Faces=demesh.Faces, Colours=demesh.Colours)
merge = Merge(Data1=mesh_visualization.Mesh, Data2=conmesh)  # -> flatten(Result)
mjoin = MeshJoin(Meshes=merge)
wbnaked = WeaverbirdsNakedBoundary(MeshClosedPolylines=mjoin)
