# Grasshopper definition millipede_topostructure3d.gh (Grasshopper 1.0.7)
# plug-ins: Millipede

box = CenterBox(Base=PlaneXY(0, 0, 0), X=Slider(26, range=0..100), Y=Slider(4, range=0..10), Z=Slider(18, range=0..100))
brep = Brep(<brep referenced from the Rhino model>)
brep_2 = Brep([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])
mat = SupportType(X=True, Y=True, Z=True, RX=True, RY=True, RZ=True)
brep_3 = Brep(box)
boundary = _3DBoundaryRegion(Boundary=brep_3, IsVoid=False)
load = _3DLoadRegion(Boundary=brep, Load=Vector(0, 0, -1))
support = _3DSupportRegion(Boundary=brep_2, SupportType=mat, AmendExistingSupports=True)
topostruct_3d = Topostruct3DModel(ModelComponents=[boundary, load, support], XResolution=Slider(40, range=0..100))  # -> FEModel, CellCentres, CellSize
topostruct_3d_solver = Topostruct3DSolver(
    FEModel=topostruct_3d.FEModel,
    SelfWeightCoefficient=0,
    OptimisationIterations=Slider(10, range=0..10),
    Smoothing=0.1,
    Penalization=3,
    TargetDensity=Slider(0.2, range=0..1),
    MinimumDensity=0.001,
    DeleteThreshold=0.5,
    PeriodicX=False,
    PeriodicY=False,
    PeriodicZ=False,
    LoadCase=0,
    AllCases=True)  # -> FEModel, MaxDeflection
_3d_iso_mesh = _3DIsoMesh(FEModel=topostruct_3d_solver.FEModel, Deflection=0, IsoContourValue=Slider(0.05, range=0..0.1), ColorMode=2)
