# Grasshopper definition Avoid_destructive_operations.gh (Grasshopper 1.0.7)

srf = Surface([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])
debrep = DeconstructBrep(Brep=srf)  # -> Faces, Edges, Vertices
debrep_2 = DeconstructBrep(Brep=srf)  # -> Faces, Edges, Vertices
divide = DivideCurve(Curve=debrep_2.Faces, Count=10, Kinks=False)  # -> Points, Tangents, Parameters
divide_2 = DivideCurve(Curve=debrep.Edges, Count=10, Kinks=False)  # -> Points, Tangents, Parameters
flatten = FlattenTree(Tree=divide.Points, Path="{0}")
trim = TrimTree(Tree=divide_2.Points, Depth=1)
lng = ListLength(List=trim)
lng_2 = ListLength(List=flatten)
series = Series(Start=0, Step=1, Count=lng)
series_2 = Series(Start=0, Step=1, Count=lng_2)
Z = UnitZ(Factor=series)
Z_2 = UnitZ(Factor=series_2)
move = Move(Geometry=trim, Motion=Z)  # -> Geometry, Transform
move_2 = Move(Geometry=flatten, Motion=Z_2)  # -> Geometry, Transform
pline = PolyLine(Vertices=move.Geometry, Closed=False)
pline_2 = PolyLine(Vertices=move_2.Geometry, Closed=False)
pipe = Pipe(Curve=pline_2, Radius=1, Caps=0)
pipe_2 = Pipe(Curve=pline, Radius=1, Caps=0)
preview = CustomPreview(Geometry=pipe, Material=ColourSwatch(SwatchColor=RGB(0, 51, 255)))
preview_2 = CustomPreview(Geometry=pipe_2, Material=ColourSwatch(SwatchColor=RGB(255, 0, 0)))
